test file "mode_logic_equivalence"
  coverage: Decision, MCDC, Condition

suite "Model-code equivalence"

  case "chart vs hand C - outputs, state, MCDC" [simulation]
    model mode_logic_equiv_harness
    pre-load callback:
      addpath('C:\Users\gusta\Desktop\vmu-final\VMU-Vehicle-Management-Unit-\verification\equivalence_live');
      tm_setup_equivalence;
    custom criteria:
      %% chart vs hand-written C: outputs AND state, subLSB excluded
      res = tm_check_equivalence(test.sltest_simout);
      test.verifyEqual(res.grid_mismatches, 0, sprintf( ...
          '%d grid rows diverged (outputs or state)', res.grid_mismatches));
      test.verifyEqual(res.state_mismatches, 0, ...
          'chart active leaf state vs C current_mode diverged on grid rows');